# Grasshopper definition spiral-torso_OSC_002_STEP800.gh (Grasshopper 1.0.8)
# plug-ins: horsterCameraControl, ChopChop, gHowl, Pancake

chopchop = ChopChop()
truebutton = TrueOnlyButton(LastSaveLocalization="neutral,N")
getcamera = GetCamera(GetCamera=truebutton)  # -> Location, Target, LensLength, UpDirection

# ---- group: OSC listenner
udp = UDPReceiver(Port="50000", Pattern=999)  # -> Info, Data
split = SplitList(List=udp.Data, Index=1)  # -> ListA, ListB
subtraction = Subtraction(A=split.ListB, B=Slider(50000, range=0..100000))
tmatch = MatchText(Text=split.ListA, Pattern="/reset", Case=False)
panel = Panel([udp.Info, udp.Data])
gain = Slider(1, range=0..1)
division = Division(A=subtraction, B=Slider(100000, range=0..100000))
item = ListItem(List=tmatch, Index=0, Wrap=True)
multiplication = Multiplication(A=division, B=gain)
panel_2 = Panel(item)
addition = Addition(A=multiplication, B=1)

# ----
merge = Merge(Data1=getcamera.Location, Data2=getcamera.Target, Data3=getcamera.LensLength, Data4=getcamera.UpDirection)
dam = DataDam(DataA=merge, BufferDelay=10000000, BufferMode=0)
item_2 = ListItem(List=dam, Index=0, Wrap=True)  # -> Item, Item1, Item2, Item3
setcam = SetCamera(
    CameraLocation=item_2.Item,
    TargetLocation=item_2.Item1,
    LensLength=item_2.Item2,
    UpDirection=item_2.Item3,
    Activate=Button())
# ↓ベルトの太さ
number_slider = Slider(1, range=0..3)
Z = UnitZ(Factor=number_slider)
# ← 床
planesrf = PlaneSurface(Plane=PlaneXY(0, 0, 0), XSize=Domain(-10, 10), YSize=Domain(-10, 10))
colour = ColourPicker(PickedColour=RGB(212, 203, 138))
material = CreateMaterial(Diffuse=colour, Specular=colour, Emission=RGB(0, 0, 0), Transparency=0, Shine=Slider(100, range=0..100))

# ---- group: base helix
# 螺旋半径→
radious = Slider(5, range=0..10)
# 巻き数→
n = Slider(10, range=0..10)
# 基準になる螺旋を
# 作っているグループ↓
number_slider_2 = Slider(1, range=0..3)
# ↑シミュレーションの解像度(有限要素法分割数)
resolution = Slider(4, range=0..100)
multiplication_2 = Multiplication(A=resolution, B=3)
# ↑
# 螺旋のピッチ
# (1節(=120°)あたりのz上昇量)
# ※1周あたりこの3倍登る
number_slider_3 = Slider(0.5, range=0..1)
pi = Pi(Factor=2)
multiplication_3 = Multiplication(A=n, B=multiplication_2)
# ↓初期位置(1段目の高さ)
number_slider_4 = Slider(1, range=0..1)
division_2 = Division(A=pi, B=multiplication_2)
division_3 = Division(A=number_slider_3, B=resolution)
addition_2 = Addition(A=multiplication_3, B=1)
series = Series(Start=number_slider_2, Step=Slider(0, range=0..0.01), Count=addition_2)
series_2 = Series(Start=0, Step=division_2, Count=addition_2)
series_3 = Series(Start=number_slider_4, Step=division_3, Count=addition_2)
Z_2 = UnitZ(Factor=series_3)

# ----
multiplication_4 = Multiplication(A=radious, B=series)

# ---- group: actuation points indices
multiplication_5 = Multiplication(A=n, B=Slider(3, range=0..10))
series_4 = Series(Start=0, Step=resolution, Count=multiplication_5)
graft = GraftTree(Tree=multiplication_3, IncludeEmptyLists=True, IncludeNullItems=True)
merge_2 = Merge(Data1=series_4, Data2=graft)

# ---- group: base helix (continued)
pt = ConstructPoint(XCoordinate=multiplication_4, YCoordinate=0, ZCoordinate=0)
rotate = Rotate(Geometry=pt, Angle=series_2, Plane=PlaneXY(0, 0, 0))  # -> Geometry, Transform
move = Move(Geometry=rotate.Geometry, Motion=Z_2)  # -> Geometry, Transform
intcrv = Interpolate(Vertices=move.Geometry, Degree=3, Periodic=False, KnotStyle=1)  # -> Curve, Length, Domain; disabled

# ----
item_3 = ListItem(List=move.Geometry, Index=merge_2, Wrap=True)
lng = ListLength(List=merge_2)
scale_nu = ScaleNU(Geometry=item_3, Plane=PlaneXY(0, 0, 0), ScaleX=addition, ScaleY=addition, ScaleZ=1)  # -> Geometry, Transform
split_2 = SplitList(List=scale_nu.Geometry, Index=lng)  # -> ListA, ListB
replace = ReplaceItems(List=move.Geometry, Item=split_2.ListA, Indices=merge_2, Wrap=False)

# ---- group: preview: shaft
# ↓アーム長さ
# ↓アーム-ベルト固定部貫通防止マージン
ln = Line(StartPoint=Point(0, 0, 0), EndPoint=Point(0, 0, 70))
crv_cp = CurveClosestPoint(Point=split_2.ListA, Curve=ln)  # -> Point, Parameter, Distance
vec2pt = Vector2Pt(PointA=split_2.ListA, PointB=crv_cp.Point, Unitize=True)  # -> Vector, Length
multiplication_6 = Multiplication(A=vec2pt.Vector, B=Slider(7.5, range=0..10))
multiplication_7 = Multiplication(A=vec2pt.Vector, B=Slider(0.5, range=0..1))
addition_3 = Addition(A=split_2.ListA, B=multiplication_6)
# アーム太さ→
addition_4 = Addition(A=split_2.ListA, B=multiplication_7)
ln_2 = Line(StartPoint=addition_3, EndPoint=addition_4)
colour_2 = ColourPicker(PickedColour=RGB(94, 94, 94))
pipe = Pipe(Curve=ln_2, Radius=Slider(0.2, range=0..1), Caps=0)
division_4 = Division(A=Z, B=2)
move_2 = Move(Geometry=pipe, Motion=division_4)  # -> Geometry, Transform
material_2 = CreateMaterial(Diffuse=colour_2, Specular=colour_2, Emission=RGB(0, 0, 0), Transparency=0, Shine=Slider(15, range=0..100))
cyl = Cylinder(Base=PlaneXY(0, 0, 0), Radius=0.5, Length=Slider(17, range=0..100))
# ← 柱と腕
preview = CustomPreview(Geometry=[move_2.Geometry, cyl, planesrf], Material=material_2)

# ---- group: solver
strength = Slider(100, range=0..10000)
shift = ShiftList(List=move.Geometry, Shift=1, Wrap=True)
series_5 = Series(Start=0, Step=0, Count=addition_2)
number_slider_5 = Slider(5, range=0..10)
item_4 = ListItem(List=move.Geometry, Index=0, Wrap=True)  # -> Item2, Item1, Item, Item1_2
ln_3 = Line(StartPoint=move.Geometry, EndPoint=shift)
_10º = PowerOf10(Value=Slider(3, range=0..10))
ln_4 = Line(StartPoint=item_4.Item2, EndPoint=item_4.Item1)
ln_5 = Line(StartPoint=item_4.Item, EndPoint=item_4.Item1_2)
Y = UnitY(Factor=1)
pline = PolyLine(Vertices=move.Geometry, Closed=False)
replace_2 = ReplaceItems(List=series_5, Item=strength, Indices=merge_2, Wrap=False)
cull_i = CullIndex(List=ln_3, Indices=-1, Wrap=True)
anchorxyz = AnchorXYZ(Point=move.Geometry, X=False, Y=False, Z=True, Strength=_10º)
rod = Rod(Polyline=pline, LengthFactor=1, AngleFactor=1, AxialStrength=strength, BendStrength=strength)
direction = Direction(Line=ln_4, Direction=Y, Strength=number_slider_5)
direction_2 = Direction(Line=ln_5, Direction=Y, Strength=number_slider_5)
# 変形シミュレーションがおかしくなったときはこのボタンでリセット
# ｜
# ｜
# ｜
# ｜
# ｜
# ｜
# ｜
# ｜
# ↓
anchor = Anchor(Point=move.Geometry, Target=replace, Strength=replace_2)
ct = ConstantTension(Line=cull_i, Strength=Slider(10, range=0..100))
merge_3 = Merge(Data1=anchor, Data2=rod, Data3=anchorxyz, Data4=ct, Data5=direction_2, Data6=direction)
and = GateAnd(A=Button(), B=item)
solver = Solver(GoalObjects=merge_3, Reset=and, Threshold=1e-15, Tolerance=0.0001, On=Toggle(True))  # -> I, V, O
panel_3 = Panel(solver.I)

# ----
intcrv_2 = Interpolate(Vertices=solver.V, Degree=3, Periodic=False, KnotStyle=1)  # -> Curve, Length, Domain
extr = Extrude(Base=intcrv_2.Curve, Direction=Z)
# ← ベルト
preview_2 = CustomPreview(Geometry=extr, Material=material)
